# Grasshopper definition Create_Gear.gh (Grasshopper 1.0.7)
# plug-ins: Human UI, GearCreation

launchwin = LaunchWindow(Show=Toggle(True), Name="Gear creation window", Width=370, Height=400, ChildStatus=0, EnableHorizScroll=False)
thickness = Slider(1, range=0.001..5)
scale_factor = Slider(1, range=1..5.001)
true_button = CreateTrueOnlyButton(ButtonName="Create", ButtonStyle=0)
slider = CreateSlider(Slider=thickness, ShowBounds=False, ShowTicks=False, ShowTooltip=False, ShowValLabel=True, showLabel=True)
slider_2 = CreateSlider(Slider=scale_factor, ShowBounds=False, ShowTicks=False, ShowTooltip=False, ShowValLabel=True, showLabel=True)
values = ValueListener(Elements=true_button, SomeProperty=True)  # -> Values, Indices
values_2 = ValueListener(Elements=slider_2, SomeProperty=True)  # -> Values, Indices
values_3 = ValueListener(Elements=slider, SomeProperty=True)  # -> Values, Indices
geartrain = CreateEndGearCutter(Button=values.Values)
num = Number("0.5")
button = CreateButton(ButtonName="Cut & Create", ButtonStyle=0)
scale = ScaleCutter(Essentials=geartrain, ScaleFactor=values_2.Values, Thickness=values_3.Values)
values_4 = ValueListener(Elements=button, SomeProperty=True)  # -> Values, Indices
merge = Merge(Data1=true_button, Data2=slider_2, Data3=slider, Data4=button)
addelems = AddElements(Window=launchwin, Elements=flatten(merge), DoVLChecking=True)  # -> AddedElements, ElementNames
cut_create = CutCreate(Button=values_4.Values, Essentials=scale, GearRatio=num)

brighness = Slider(10, range=0..10)
slider_3 = CreateSlider(Slider=brighness, ShowBounds=False, ShowTicks=False, ShowTooltip=False, ShowValLabel=True, showLabel=True)
adjustpos = AdjustElementPositioning(ElementsToAdjust=slider_3, Margin="0,30,0,0", AbsolutePositioning=False)

brighness_2 = Slider(10, range=0..10)
slider_4 = CreateSlider(Slider=brighness_2, ShowBounds=False, ShowTicks=False, ShowTooltip=False, ShowValLabel=True, showLabel=True)
adjustpos_2 = AdjustElementPositioning(ElementsToAdjust=slider_4, Margin="0,30,0,0", AbsolutePositioning=False)
