# Grasshopper definition Test_Gear.gh (Grasshopper 1.0.7)
# plug-ins: Human UI, GearCreation

launchwin = LaunchWindow(Show=Toggle(True), Name="Gear creation window", Width=370, Height=400, ChildStatus=0, EnableHorizScroll=False)
button = CreateButton(ButtonName="Create", ButtonStyle=0)
values = ValueListener(Elements=button, SomeProperty=True)  # -> Values, Indices
bevelgearset = CreateBevelGearSet(Button=values.Values)
addelems = AddElements(Window=launchwin, Elements=flatten(button), DoVLChecking=True)  # -> AddedElements, ElementNames

brighness = Slider(10, range=0..10)
slider = CreateSlider(Slider=brighness, ShowBounds=False, ShowTicks=False, ShowTooltip=False, ShowValLabel=True, showLabel=True)
adjustpos = AdjustElementPositioning(ElementsToAdjust=slider, Margin="0,30,0,0", AbsolutePositioning=False)

brighness_2 = Slider(10, range=0..10)
slider_2 = CreateSlider(Slider=brighness_2, ShowBounds=False, ShowTicks=False, ShowTooltip=False, ShowValLabel=True, showLabel=True)
adjustpos_2 = AdjustElementPositioning(ElementsToAdjust=slider_2, Margin="0,30,0,0", AbsolutePositioning=False)
